# Grasshopper definition koriobots_example_follow_path.gh (Grasshopper 1.0.7)
# plug-ins: RhinoCodePluginGH

# ----
# Network Settings
number_slider = Slider(55555, range=50000..59999)

# ----
# Controls
panel = Panel("/stop")
oscsender_py3 = Python3Script(host="127.0.0.1", port=number_slider, msg_addr=panel, data=Button())  # -> out, a; inputs host: String, port: Int32, msg_addr: String, data: list
# ---------- oscsender_py3: Python ----------
from pythonosc import udp_client

# set up the OSC Sender
client = udp_client.SimpleUDPClient(host, port) 
# send the message       
client.send_message(msg_addr, data)
# ---------- end oscsender_py3 ----------
oscsender_py3_2 = Python3Script(host="127.0.0.1", port=number_slider, msg_addr="/move_vel", data=Toggle(False))  # -> out, a; inputs host: String, port: Int32, msg_addr: String, data: list; same code as oscsender_py3

# ---- group: Safety Bounds
number_slider_2 = Slider(10, range=1..10)
pt = ConstructPoint(XCoordinate=expr("x/2*-1", number_slider_2), YCoordinate=expr("x/2*-1", number_slider_2), ZCoordinate=0)
planesrf = PlaneSurface(Plane=pt, XSize=number_slider_2, YSize=number_slider_2)

# ---- group: Path to Follow
crv = Curve(<curve referenced from the Rhino model>)
eval = EvaluateCurve(Curve=reparameterize(crv), Parameter=Slider(0, range=0..1))  # -> Point, Tangent, Angle

# ----
srf_cp = SurfaceClosestPoint(Point=eval.Point, Surface=reparameterize(planesrf))  # -> Point, UVPoint, Distance
pdecon = Deconstruct(Point=srf_cp.UVPoint)  # -> XComponent, YComponent, ZComponent
remap = RemapNumbers(Value=pdecon.YComponent, Source=Domain(0, 1), Target=Domain(1, 0))  # -> Mapped, Clipped

# ----
# Motion
index = Slider(-1, range=-1..7)
merge = Merge(Data1=index, Data2=pdecon.XComponent, Data3=remap.Mapped)
oscsender_py3_3 = Python3Script(host="127.0.0.1", port=number_slider, msg_addr="/norm", data=merge)  # -> out, a; inputs host: String, port: Int32, msg_addr: String, data: list
# ---------- oscsender_py3_3: Python ----------
from pythonosc import udp_client

# set up the OSC Sender
client = udp_client.SimpleUDPClient(host, port)
# cast index from float to int
data[0] = int(data[0])   
# send the message       
client.send_message(msg_addr, data)
# ---------- end oscsender_py3_3 ----------
oscsender_py3_4 = Python3Script(host="127.0.0.1", port=number_slider, msg_addr="/reset", data=Button())  # -> out, a; inputs host: String, port: Int32, msg_addr: String, data: list; same code as oscsender_py3

# ----
# Limits
velocity = Slider(0.415, range=0..1)
acceleration = Slider(0.493, range=0..1)
merge_2 = Merge(Data1=velocity, Data2=acceleration)
oscsender_py3_5 = Python3Script(host="127.0.0.1", port=number_slider, msg_addr="/limits", data=merge_2)  # -> out, a; inputs host: String, port: Int32, msg_addr: String, data: list
# ---------- oscsender_py3_5: Python ----------
from pythonosc import udp_client

# set up the OSC Sender
client = udp_client.SimpleUDPClient(host, port)
 
# send the message
addr = msg_addr + "/velocity"  
val = data[0]
client.send_message(addr, val)

addr = msg_addr + "/acceleration"  
val = data[1]
client.send_message(addr, val)
# ---------- end oscsender_py3_5 ----------

# ----
# Bounds
x = Slider(0.5, range=0..1)
y = Slider(0.5, range=0..1)
w = Slider(0.25, range=0..1)
h = Slider(0.25, range=0..1)

remap_2 = RemapNumbers(Value=y, Source=Domain(0, 1), Target=Domain(1, 0))  # -> Mapped, Clipped

merge_3 = Merge(Data1=x, Data2=remap_2.Mapped, Data3=w, Data4=h)
oscsender_py3_6 = Python3Script(host="127.0.0.1", port=number_slider, msg_addr="/bounds", data=merge_3)  # -> out, a; inputs host: String, port: Int32, msg_addr: String, data: list
# ---------- oscsender_py3_6: Python ----------
from pythonosc import udp_client

# set up the OSC Sender
client = udp_client.SimpleUDPClient(host, port)
 
# send the message
addr = msg_addr + "/pos"  
val = [data[0], data[1]]
client.send_message(addr, val)

addr = msg_addr + "/width"  
val = data[2]
client.send_message(addr, val)

addr = msg_addr + "/height"  
val = data[3]
client.send_message(addr, val)
# ---------- end oscsender_py3_6 ----------
