# Grasshopper definition koriobot_controller.ghx (Grasshopper 1.0.8)
# plug-ins: RhinoCodePluginGH

# ----
# Network Settings
number_slider = Slider(55555, range=50000..59999)

# ----
# Controls
panel = Panel("/stop")
oscsender_py3 = Python3Script(host="127.0.0.1", port=number_slider, msg_addr=panel, data=Button())  # -> out, a; inputs host: String, port: Int32, msg_addr: String, data: list
# ---------- oscsender_py3: Python ----------
# r: python-osc
from pythonosc import udp_client

# set up the OSC Sender
client = udp_client.SimpleUDPClient(host, port) 
# send the message       
client.send_message(msg_addr, data)
# ---------- end oscsender_py3 ----------
oscsender_py3_2 = Python3Script(host="127.0.0.1", port=number_slider, msg_addr="/move_vel", data=Toggle(False))  # -> out, a; inputs host: String, port: Int32, msg_addr: String, data: list; same code as oscsender_py3

# ----
# Motion
index = Slider(-1, range=-1..7)
x = Slider(0.5, range=0..1)
y = Slider(0.5, range=0..1)
merge = Merge(Data1=index, Data2=x, Data3=y)
oscsender_py3_3 = Python3Script(host="127.0.0.1", port=number_slider, msg_addr="/norm", data=merge)  # -> out, a; inputs host: String, port: Int32, msg_addr: String, data: list
# ---------- oscsender_py3_3: Python ----------
# r: python-osc
from pythonosc import udp_client

# set up the OSC Sender
client = udp_client.SimpleUDPClient(host, port)
# cast index from float to int
data[0] = int(data[0])   
# send the message       
client.send_message(msg_addr, data)
# ---------- end oscsender_py3_3 ----------
oscsender_py3_4 = Python3Script(host="127.0.0.1", port=number_slider, msg_addr="/reset", data=Button())  # -> out, a; inputs host: String, port: Int32, msg_addr: String, data: list; same code as oscsender_py3

# ----
# Limits
velocity = Slider(0.415, range=0..1)
acceleration = Slider(0.493, range=0..1)
merge_2 = Merge(Data1=velocity, Data2=acceleration)
oscsender_py3_5 = Python3Script(host="127.0.0.1", port=number_slider, msg_addr="/limits", data=merge_2)  # -> out, a; inputs host: String, port: Int32, msg_addr: String, data: list
# ---------- oscsender_py3_5: Python ----------
# r: python-osc
from pythonosc import udp_client

# set up the OSC Sender
client = udp_client.SimpleUDPClient(host, port)
 
# send the message
addr = msg_addr + "/velocity"  
val = data[0]
client.send_message(addr, val)

addr = msg_addr + "/acceleration"  
val = data[1]
client.send_message(addr, val)
# ---------- end oscsender_py3_5 ----------

# ----
# Bounds
x_2 = Slider(0.5, range=0..1)
y_2 = Slider(0.5, range=0..1)
w = Slider(0.25, range=0..1)
h = Slider(0.25, range=0..1)

remap = RemapNumbers(Value=y_2, Source=Domain(0, 1), Target=Domain(1, 0))  # -> Mapped, Clipped

merge_3 = Merge(Data1=x_2, Data2=remap.Mapped, Data3=w, Data4=h)
oscsender_py3_6 = Python3Script(host="127.0.0.1", port=number_slider, msg_addr="/bounds", data=merge_3)  # -> out, a; inputs host: String, port: Int32, msg_addr: String, data: list
# ---------- oscsender_py3_6: Python ----------
# r: python-osc
from pythonosc import udp_client

# set up the OSC Sender
client = udp_client.SimpleUDPClient(host, port)
 
# send the message
addr = msg_addr + "/pos"  
val = [data[0], data[1]]
client.send_message(addr, val)

addr = msg_addr + "/width"  
val = data[2]
client.send_message(addr, val)

addr = msg_addr + "/height"  
val = data[3]
client.send_message(addr, val)
# ---------- end oscsender_py3_6 ----------
